# Grasshopper definition WaveFunctionCollapse.gh (Grasshopper 1.0.4)
# plug-ins: WaveFunctionCollapse

panel = Panel("FULL TILE")
full_tile = Surface(graft([<surface referenced from the Rhino model> x12]))
box_corners = BoxCorners(Box=full_tile)  # -> CornerA, CornerB, CornerC, CornerD, CornerE, CornerF, CornerG, CornerH
average = Average(Input=[box_corners.CornerC, box_corners.CornerA, box_corners.CornerB, box_corners.CornerD])  # -> flatten(ArithmeticMean)
panel_2 = Panel(average)

panel_3 = Panel("Sample Tile Size")
tiles_area = Surface(<surface referenced from the Rhino model>)
dimensions = Dimensions(Surface=tiles_area)  # -> UDimension, VDimension
divide_surface = DivideSurface(Surface=tiles_area, UCount=dimensions.UDimension, VCount=dimensions.VDimension)  # -> flatten(Points), Normals, Parameters
c_script = CSharpScript(PointsX=divide_surface.Points)  # -> out, flatten(A), B; inputs PointsX: list of Point3d
# ---------- c_script: C# ----------
    var res = new List<Point3d>();

    for (int i = 0; i < PointsX.Count; i++)
    {

      if (Convert.ToInt32(PointsX[i].X) % 2 != 0 && Convert.ToInt32(PointsX[i].Y) % 2 != 0)
      {
        res.Add(PointsX[i]);
      }

    }

    A = res;

    B = PointsX.Count;
# ---------- end c_script ----------

panel_4 = Panel("HALF TILE")
half_tile = Surface(graft([<surface referenced from the Rhino model> x4]))
box_corners_2 = BoxCorners(Box=half_tile)  # -> CornerA, CornerB, CornerC, CornerD, CornerE, CornerF, CornerG, CornerH
average_2 = Average(Input=[box_corners_2.CornerB, box_corners_2.CornerA, box_corners_2.CornerC, box_corners_2.CornerD])  # -> flatten(ArithmeticMean)
panel_5 = Panel(average_2)

tiles_area_2 = Surface(<surface referenced from the Rhino model>)
dimensions_2 = Dimensions(Surface=tiles_area_2)  # -> UDimension, VDimension
divide_surface_2 = DivideSurface(Surface=tiles_area_2, UCount=dimensions_2.UDimension, VCount=dimensions_2.VDimension)  # -> flatten(Points), Normals, Parameters
c_script_2 = CSharpScript(PointsX=divide_surface_2.Points)  # -> out, flatten(A), B; inputs PointsX: list of Point3d; same code as c_script
panel_6 = Panel(c_script.A)
patterns_testtt = Patterns_testtt(TileTypeA=average_2, TileTypeB=average, WholeTilePoints=c_script.A)  # -> PatternFromSampleParameter, HalfTiles, FullTiles, EmptyTiles
panel_7 = Panel(c_script_2.A)
colour_swatch = ColourSwatch(SwatchColor=RGB(227, 129, 129))
custom_preview = CustomPreview(Geometry=half_tile, Material=colour_swatch)
colour_swatch_2 = ColourSwatch(SwatchColor=RGB(84, 143, 150))
custom_preview_2 = CustomPreview(Geometry=full_tile, Material=colour_swatch_2)
custom_preview_3 = CustomPreview(Geometry=full_tile, Material=colour_swatch_2)
wavefunctioncollapse = WaveFunctionCollapse(PatternFromSampleParameter=patterns_testtt.PatternFromSampleParameter, Wave=c_script_2.A)  # -> NumberOfRotatedTiles, PanelTexts, PatternHistoryParameter
colour_swatch_3 = ColourSwatch(SwatchColor=RGB(224, 222, 211))

# ---- group: FULL TILE POINTS
tile_a = Surface(<surface referenced from the Rhino model>)
c_script_3 = CSharpScript(Surface=tile_a, Vector=patterns_testtt.FullTiles)  # -> out, A; inputs Surface: Surface, Vector: Vector3d
# ---------- c_script_3: C# ----------
    var copy = Surface.Duplicate();
    copy.Translate(Vector);

    A = copy;
# ---------- end c_script_3 ----------
custom_preview_4 = CustomPreview(Geometry=c_script_3.A, Material=colour_swatch_2)

# ---- group: HALF TILE POINTS
tile_b = Surface(<surface referenced from the Rhino model>)
c_script_4 = CSharpScript(Surface=tile_a, Vector=patterns_testtt.HalfTiles)  # -> out, A; inputs Surface: Surface, Vector: Vector3d; same code as c_script_3
custom_preview_5 = CustomPreview(Geometry=c_script_4.A, Material=colour_swatch)

# ----
c_script_5 = CSharpScript(runtimer=Toggle(False))  # -> out, A; inputs runtimer: Boolean
# ---------- c_script_5: C# ----------
    if(runtimer) Example.TurnOnTimer();
    if(!runtimer) Example.TurnOffTimer();
    A = rtnlist;
# ---------- c_script_5: C# additional code ----------
  public static List<string> rtnlist = new List<string>();

  public class Example
  {
    public static System.Timers.Timer aTimer = new System.Timers.Timer(1000);

    public static void TurnOnTimer()
    {
      rtnlist.Clear();
      aTimer.Elapsed += OnTimedEvent;
      aTimer.Enabled = true;
    }

    public static void TurnOffTimer()
    {
      aTimer.Elapsed -= OnTimedEvent;
      aTimer.Enabled = false;
    }

    private static void OnTimedEvent(Object source, System.Timers.ElapsedEventArgs e)
    {
      rtnlist.Add(e.SignalTime.ToString());
    }
  }
# ---------- end c_script_5 ----------
panel_8 = Panel(c_script_5.A)
visualise_by_history = VisualiseByHistory(
    WaveFunctionCollapsed=wavefunctioncollapse.PatternHistoryParameter,
    Timelapse=Slider(1, range=0..1),
    TILE01=tile_a,
    TILE02=tile_a,
    XWAVELOCATION=Slider(17, range=0..30),
    YWAVELOCATION=Slider(63, range=0..100),
    Tile01Colour=colour_swatch,
    Tile02Colour=colour_swatch_2,
    TileEmpty=colour_swatch_3)  # -> WaveHalfSurfaces, WaveFullSurfaces, WaveEmptySurfaces, Colours, Uncollapsed

# ---- group: NULL TILES
tile_a_2 = Surface(<surface referenced from the Rhino model>)
colour_swatch_4 = ColourSwatch(SwatchColor=RGB(143, 141, 150))
c_script_6 = CSharpScript(Surface=tile_a_2, Vector=patterns_testtt.EmptyTiles)  # -> out, A; inputs Surface: Surface, Vector: Vector3d; same code as c_script_3
custom_preview_6 = CustomPreview(Geometry=c_script_6.A, Material=colour_swatch_3)

# ----
number_slider = Slider(2, range=0..10)
number_slider_2 = Slider(63, range=0..160)
number_slider_3 = Slider(74, range=-30..100)
custom_preview_7 = CustomPreview(Geometry=visualise_by_history.Uncollapsed, Material=visualise_by_history.Colours)
custom_preview_8 = CustomPreview(Geometry=visualise_by_history.WaveHalfSurfaces, Material=colour_swatch)
custom_preview_9 = CustomPreview(Geometry=visualise_by_history.WaveFullSurfaces, Material=colour_swatch_2)
custom_preview_10 = CustomPreview(Geometry=visualise_by_history.WaveEmptySurfaces, Material=colour_swatch_3)
evaluateproportions = EvaluateProportions(
    WaveHalfSurfaces=visualise_by_history.WaveHalfSurfaces,
    WaveFullSurfaces=visualise_by_history.WaveFullSurfaces,
    WaveEmptySurfaces=visualise_by_history.WaveEmptySurfaces,
    X=number_slider_3,
    Y=number_slider_2)  # -> port, port_2, port_3, port_4, port_5, port_6
subtraction = Subtraction(A=number_slider_2, B=number_slider)
series = Series(Start=number_slider_3, Step=number_slider, Count=Slider(3, range=0..10))
construct_point = ConstructPoint(XCoordinate=series, YCoordinate=subtraction, ZCoordinate=0)
panel_9 = Panel(series)
text_tag = TextTag(
    Location=construct_point,
    Text=[evaluateproportions.port_4, evaluateproportions.port_5, evaluateproportions.port_6],
    Colour=ColourSwatch(SwatchColor=RGB(71, 71, 71)))
custom_preview_11 = CustomPreview(Geometry=evaluateproportions.port, Material=colour_swatch)
custom_preview_12 = CustomPreview(Geometry=evaluateproportions.port_3, Material=colour_swatch_3)
custom_preview_13 = CustomPreview(Geometry=evaluateproportions.port_2, Material=colour_swatch_2)
panel_10 = Panel(construct_point)
